# Grasshopper definition MJProcGen.gh (Grasshopper 1.0.8)
# plug-ins: MJ_Proc_Gen

panel = Panel("C:\Users\Drew\Desktop\Projects\MJ Proc Gen\rulesets\trees.xml")
panel_2 = Panel("C:\Users\Drew\Desktop\Projects\MJ Proc Gen\rulesets\huts.xml")
panel_3 = Panel("C:\Users\Drew\Desktop\Projects\MJ Proc Gen\rulesets\random.xml")
panel_4 = Panel("C:\Users\Drew\Desktop\Projects\MJ Proc Gen\rulesets\rotref.xml")
panel_5 = Panel("C:\Users\Drew\Desktop\Projects\MJ Proc Gen\rulesets\walker.xml")
panel_6 = Panel("C:\Users\Drew\Desktop\Projects\MJ Proc Gen\rulesets\walkerRetrace.xml")

# ---- group: Create Space
number_slider = Slider(16, range=1..100)
number_slider_2 = Slider(16, range=1..100)
number_slider_3 = Slider(16, range=1..100)
panel_7 = Panel("space")
mj_space = MJSpace(Name=panel_7, XSize=number_slider, YSize=number_slider_2, ZSize=number_slider_3, DefaultState="O")

# ---- group: Run Parameters
number_slider_4 = Slider(10000, range=0..1000000)
number_slider_5 = Slider(302443, range=-1000000..1000000)
frame_100 = Slider(0, range=0..100)
frame_1000 = Slider(0, range=0..1000)
frame_10000 = Slider(1042, range=0..10000)
panel_8 = Panel("walkerRetrace")
refresh = Button()

# ---- group: RuleSet file paths
rulesets = Merge(Data1=panel, Data2=panel_2, Data3=panel_3, Data4=panel_4, Data5=panel_5, Data6=panel_6)

# ---- group: Initiate Main
refresh_2 = Button()
init_mj = InitiateMJ(Spaces=mj_space, Rulesets=rulesets, EnableDebug=Toggle(False), Refresh=refresh_2)  # -> MJ_Main, DebugLog

# ----
geo = Geometry(<extrusion referenced from the Rhino model>)
geo_2 = Geometry(<brep referenced from the Rhino model>)
geo_3 = Geometry(<surface referenced from the Rhino model>)
pt = Point(<point referenced from the Rhino model>)
geo_4 = Geometry(<extrusion referenced from the Rhino model>)
pt_2 = Point(<point referenced from the Rhino model>)
pt_3 = Point(<point referenced from the Rhino model>)
pt_4 = Point(<point referenced from the Rhino model>)
pt_5 = Point(<point referenced from the Rhino model>)
geo_5 = Geometry(<brep referenced from the Rhino model>)
sample = Sample(ReferenceName="H", ReferencePoint=pt_5, Geometry=geo_5)
sample_2 = Sample(ReferenceName="O", ReferencePoint=pt)
sample_3 = Sample(ReferenceName="G", ReferencePoint=pt, Geometry=geo_4)
sample_4 = Sample(ReferenceName="T", ReferencePoint=pt_2, Geometry=geo)
sample_5 = Sample(ReferenceName="S", ReferencePoint=pt_3, Geometry=geo_2)
sample_6 = Sample(ReferenceName="L", ReferencePoint=pt_4, Geometry=geo_3)
run_mj = RunMJ(
    MJ_Main=init_mj.MJ_Main,
    Space=panel_7,
    Ruleset=panel_8,
    MaximumOperations=number_slider_4,
    RandomSeed=number_slider_5,
    Refresh=refresh)  # -> MJ_Main, DebugLog

# ---- group: Model Frame Parameters
number_slider_6 = Slider(10, range=0..10)
merge = Merge(Data1=sample_2, Data2=sample_3, Data3=sample_4, Data4=sample_5, Data5=sample_6, Data6=sample)

# ----
panel_9 = Panel(run_mj.DebugLog)

# ---- group: Output MJ
output_mj = OutputMJ(MJ_Main=run_mj.MJ_Main, Space=panel_7, Frame=frame_10000)  # -> MJ_Main, OperationCount, FrameCount, Frame, AllFrames
op_count = Panel(output_mj.OperationCount)
frame_count = Panel(output_mj.FrameCount)
panel_10 = Panel(output_mj.Frame)

# ---- group: Model Frame
model_frame = ModelFrame(
    Frame=output_mj.Frame,
    XSize=number_slider,
    YSize=number_slider_2,
    ZSize=number_slider_3,
    Spacing=number_slider_6,
    Samples=merge)
geo_6 = Geometry(model_frame)
material = CreateMaterial(
    Diffuse=ColourSwatch(SwatchColor=RGB(111, 181, 217)),
    Specular=RGB(255, 255, 255),
    Emission=RGB(0, 0, 0),
    Transparency=0,
    Shine=0)
preview = CustomPreview(Geometry=geo_6, Material=material)
